# Dynamo graph BoqExportToXLS.dyn (Dynamo 2.16.1.2727)

string = StringInput("BoqExportToXLS.py")
file_from_path = FileObject(path=string)
readText = FileSystem.ReadText(file=file_from_path)
path = CodeBlock(path=file_from_path) { path; }
reload = BoolSelector(false)

# group: BOQ Info
# BOQ Info
BOQ_Name = StringInput("BER-GF-SE-CP-00-SH-E-TSLA-8002-09")
rev_seq_n = IntegerSlider(725, range=0..5000 step 1)
elem_filter_name = StringInput("Phase 1b (50GWh)")

python_script_from_string = PythonStringNode(script=readText, IN[0]=path, IN[1]=reload, IN[2]=BOQ_Name, IN[3]=rev_seq_n, IN[4]=elem_filter_name)  # CPython3
elem_filter_name_2 = StringInput("TESLA-DCNOT-001722")
