# Dynamo graph ChangeHostBasedFamily.dyn (Dynamo 2.16.2.5624)

string = StringInput("CopyFromDataCircuitToElem.py")  # graph input
file_from_path = FileObject(path=string)
readText = FileSystem.ReadText(file=file_from_path)
reload = BoolSelector(true)

# group: Existing Instances info
instanceToChange = DSModelElementSelection()  # nothing selected; graph input
changeAllInstancies = BoolSelector(false)

# group: New element Type
newTypeName = StringInput("")

code_block = CodeBlock(IN2=instanceToChange, IN3=changeAllInstancies, IN4=newTypeName) { IN2; IN3; IN4; }
python_script_from_string = PythonStringNode(script=readText, IN[0]=file_from_path, IN[1]=reload, IN[2]=code_block.IN2, IN[3]=code_block.IN3, IN[4]=code_block.IN4)  # CPython3
