# Dynamo graph ElectricalPanelDiagramm.dyn (Dynamo 2.13.1.3887)

string = StringInput("ElectricalPanelDiagramm.py")  # graph input
file_from_path = FileObject(path=string)
readText = FileSystem.ReadText(file=file_from_path)
reload = BoolSelector(true)

# group: IN
elementOnView = DSModelElementSelection()  # 1 picked in the model; graph input
panel = DSModelElementSelection()  # 1 picked in the model; graph input

python_script_from_string = PythonStringNode(script=readText, IN[0]=file_from_path, IN[1]=reload, IN[2]=elementOnView, IN[3]=panel)  # CPython3
