# Dynamo graph MoveCircuitsByScheduleNumber.dyn (Dynamo 2.3.0.5885)

string = StringInput("MoveCircuitsByScheduleNumber.py")  # graph input
file_from_path = FileObject(path=string)
readText = FileSystem.ReadText(file=file_from_path)
reload = BoolSelector(true)
copyFrom = DSModelElementSelection()  # 1 picked in the model
copyTo = DSModelElementSelection()  # 1 picked in the model
start_end_rows = CodeBlock { 1; 1; }
python_script_from_string = PythonStringNode(script=readText, IN[0]=file_from_path, IN[1]=reload, IN[2]=copyFrom, IN[3]=copyTo, IN[4]=start_end_rows.out0, IN[5]=start_end_rows.out1)
