# Dynamo graph PanelZoneLines.dyn (Dynamo 2.16.1.2727)

string = StringInput("PanelZoneLines.py")  # graph input
file_from_path = FileObject(path=string)
readText = FileSystem.ReadText(file=file_from_path)

# group: Reload
# Reload
reload = BoolSelector(false)

python_script_from_string = PythonStringNode(script=readText, IN[0]=file_from_path, IN[1]=reload)  # CPython3
