# Dynamo graph PrintPDF.dyn (Dynamo 2.16.1.2727)

string = StringInput("get_local_printers.py")  # graph input; frozen
file_from_path = FileObject(path=string)
readText = FileSystem.ReadText(file=file_from_path)

# group: Reload
# Reload
reload = BoolSelector(true)  # frozen

python_script_from_string = PythonStringNode(script=readText, IN[0]=file_from_path, IN[1]=reload)  # CPython3
code_block = CodeBlock(Printer=python_script_from_string) { Printer[5]; }
string_2 = StringInput("PrintPDF.py")  # graph input
file_from_path_2 = FileObject(path=string_2)
readText_2 = FileSystem.ReadText(file=file_from_path_2)

# group: Reload
# Reload
reload_2 = BoolSelector(true)

printerDrivers = CodeBlock { "PDFCreator"; "PDF24"; }
printerDefaultPath = StringInput("C:\05 TEMP\PrintTest")  # graph input
printToPath = StringInput("C:\05 TEMP\PrintTest")  # graph input
python_script_from_string_2 = PythonStringNode(script=readText_2, IN[0]=file_from_path_2, IN[1]=reload_2, IN[2]=printerDrivers.out0, IN[3]=printerDefaultPath, IN[4]=printToPath)  # CPython3; unwired: IN[5]
sheets = Sheets("ELECTRICAL FACILITY POWER LEVEL 1F - OVERALL LAYOUT")
getSheetsByListOfNumbers = CodeBlock()
# ---------- getSheetsByListOfNumbers.designscript (3 lines) ----------
[
"BER-GF-SE-CP-XX-DR-E-JACO-5000-00-000"
];
# ----------------------------------------
getSheetsByRevisionName = StringInput("")
