# Dynamo graph ReadDataCircuitWriteToParam.dyn (Dynamo 2.3.0.5885)

reload = BoolSelector(false)
python_script_from_string = PythonStringNode(IN[0]=reload)  # unwired: script, IN[1]
string = StringInput("ReadDataCircuitWriteToParam.py")  # graph input
