# Dynamo graph SingleLineDiagramm.dyn (Dynamo 2.13.1.3887)

string = StringInput("SingleLineDiagramm.py")  # graph input
file_from_path = FileObject(path=string)
readText = FileSystem.ReadText(file=file_from_path)

# group: Reload
# Reload
reload = BoolSelector(false)

select_model_element = DSModelElementSelection()  # 1 picked in the model; graph input
select_model_element_2 = DSModelElementSelection()  # nothing selected; graph input
python_script_from_string = PythonStringNode(script=readText, IN[0]=file_from_path, IN[1]=reload, IN[2]=select_model_element, IN[3]=select_model_element_2)  # CPython3
